# Grasshopper definition Data Visualization.gh (Grasshopper 1.0.7)
# plug-ins: Human

path = FilePath("C:\Users\lisa_\Desktop\Skill1\Points Data.csv")
number_slider = Slider(90, range=0..100)
file = ReadFile(File=path, PerLineParse=True)
point = Point([<point referenced from the Rhino model> x3522])
geo = Geometry(<brep referenced from the Rhino model>)
geometry = Geometry(<brep referenced from the Rhino model>)
cull_i = CullIndex(List=file, Indices=0, Wrap=True)
project_point = ProjectPoint(Point=point, Direction=Vector(0, 0, -1), Geometry=geometry)  # -> Point, Index
sdivide = DivideSurface(Surface=reparameterize(geo), UCount=number_slider, VCount=Slider(68, range=0..100))  # -> simplify(Points), Normals, Parameters
split = TextSplit(Text=cull_i, Separators=",")
panel = Panel(split)
deconstruct = Deconstruct(Point=point)  # -> XComponent, YComponent, ZComponent
panel_2 = Panel(cull_i)
line = Line(StartPoint=project_point.Point, EndPoint=point)
image = ImageSampler(sdivide.Parameters, Filter="Value", Interpolate=True, Umax=1, Umin=0, Vmax=1, Vmin=0, Wrap=1)
panel_3 = Panel(image)
item = ListItem(List=split, Index="0", Wrap=True)  # -> graft(Item), graft(Item1)
item_2 = ListItem(List=split, Index="11", Wrap=True)  # -> simplify(Item)
panel_4 = Panel(sdivide.Points)
bnd = Bounds(Numbers=flatten(line))
bnd_2 = Bounds(Numbers=flatten(item_2))
Z = UnitZ(Factor=image)
graph = GraphMapper(
    image,
    x0=0,
    x1=1,
    y0=0,
    y1=1,
    container_name="Bezier",
    cpx=[0, 0.465043664, 0.4682599604, 1],
    cpy=[0, 0.2217986584, 0.6848033667, 1])
dedomain = DeconstructDomain(Domain=bnd)  # -> Start, End
pt = ConstructPoint(XCoordinate=item.Item, YCoordinate=item.Item1, ZCoordinate=item_2)
dedomain_2 = DeconstructDomain(Domain=bnd_2)  # -> Start, End
multiplication = Multiplication(A=Z, B=Slider(500, range=0..500))
gradient = Gradient(
    LowerLimit=dedomain_2.Start,
    UpperLimit=dedomain_2.End,
    Parameter=item_2,
    stops=[0.356: RGB(192, 192, 255), 0.985: RGB(192, 255, 255)])
gradient_2 = Gradient(
    LowerLimit=dedomain.Start,
    UpperLimit=dedomain.End,
    Parameter=deconstruct.ZComponent,
    stops=[0.482: RGB(192, 192, 255), 0.985: RGB(192, 255, 255)])
panel_5 = Panel(pt)
move = Move(Geometry=sdivide.Points, Motion=multiplication)  # -> Geometry, Transform
srfgrid = SurfaceFromPoints(Points=flatten(move.Geometry), UCount=expr("x+1", number_slider), Interpolate=False)
preview = CustomPreview(Geometry=pt, Material=gradient)
preview_2 = CustomPreview(Geometry=line, Material=gradient_2)
createatts = CreateAttributes(Color=gradient_2, enableFullPath=False)
createatts_2 = CreateAttributes(Color=gradient, enableFullPath=False)
series = Series(Start=0, Step="10", Count="150")
xy = XYPlane(Origin=Point(0, 0, 0))
contour = ContourEx(Shape=srfgrid, Plane=xy, Offsets=series)
bake = BakeGeometry(Bake=Toggle(False), Geometry=line, Attributes=createatts, DeleteOldBakes=False, PreserveTrees=False)
bake_2 = BakeGeometry(Bake=Toggle(False), Geometry=pt, Attributes=createatts_2, DeleteOldBakes=False, PreserveTrees=False)
eval = EvaluateCurve(Curve=contour, Parameter=0)  # -> Point, Tangent, Angle
pdecon = Deconstruct(Point=flatten(eval.Point))  # -> XComponent, YComponent, ZComponent
bnd_3 = Bounds(Numbers=pdecon.ZComponent)
dedomain_3 = DeconstructDomain(Domain=bnd_3)  # -> Start, End
gradient_3 = Gradient(
    LowerLimit=dedomain_3.End,
    UpperLimit=dedomain_3.Start,
    Parameter=pdecon.ZComponent,
    stops=[0: RGB(128, 128, 255), 0: RGB(234, 126, 0), 0: RGB(223, 249, 107), 0: RGB(108, 79, 3), 0: RGB(137, 89, 249), 0: RGB(254, 244, 84), 0: RGB(68, 8, 74), 0: RGB(79, 227, 49), 0: RGB(100, 58, 209), 1: RGB(216, 191, 216), 1: RGB(75, 107, 169)])
preview_3 = CustomPreview(Geometry=flatten(contour), Material=gradient_3)
createatts_3 = CreateAttributes(Color=gradient_3, GroupIndices="1", enableFullPath=False)
bake_3 = BakeGeometry(Bake=Button(), Geometry=flatten(contour), Attributes=createatts_3, DeleteOldBakes=False, PreserveTrees=False)
